# Grasshopper definition MSGraphAuthenticationDemo.gh (Grasshopper 1.0.7)
# plug-ins: BH.UI.Grasshopper

# these settings could be within the code - no security risk
signinmethod = SignInMethod(
    {"Default": 0, "AccountUsedToSignedInToWindows": 1, "OneOfTheAccountsKnownByWindows": 2, "AnyAccount": 3}, selected="Default",
    Component="BH.oM.Adapters.MSGraph.SignInMethod",
    Selection=0)
# https://graph.microsoft.com/v1.0/groups?$select=id,displayName
# https://graph.microsoft.com/beta/termStore/groups
panel = Panel("https://graph.microsoft.com/v1.0/users?$select=id,displayName")
# toggle to trigger login
toggle = BooleanToggle(True)
msgraphsettings = MSGraphSettings(
    ClientId="394b3057-2190-4686-92fa-dfbffdbd4bb5",
    Tenant="8258b4d0-de8b-4ef3-a120-1dec3cd88f75",
    Instance="https://login.microsoftonline.com/",
    SignInMethod=signinmethod,
    Paginate=toggle,
    TimeOut="1000",
    Component="BH.oM.Adapters.MSGraph.MSGraphSettings")
msgraphadapter = MSGraphAdapter(GraphSettings=msgraphsettings, Active=Toggle(False), ResetToken=Toggle(False), Component="{ ..ctor")
explode = Explode(Object=msgraphadapter, Component="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")  # -> Token, Settings, AdapterIdFragmentType, AdapterModules, AdapterComparers, DependencyTypes, AdapterGuid
# settings and token passed to pull after login
getrequest = GetRequest(BaseUrl=panel, Headers=null, Parameters=null, Component="BH.oM.Adapters.HTTP.GetRequest")
panel_2 = Panel(explode.Token)
# need better warnings and errors:
# login in to query
# you are not authorized
# etc ...
pull = Pull(
    Adapter=msgraphadapter,
    Request=getrequest,
    PullType="{ \"_t\" : \"System.Enum\", \"TypeName\" : { \"_t\" : \"System.Type\", \"Name\" : \"BH.oM.Adapter.PullType\", \"_bhomVersion\" : \"6.1\" }, \"Value\" : \"AdapterDefault\", \"_bhomVersion\" : \"6.1\" }",
    Active=Toggle(False),
    Component="{ .Pull")
explode_2 = Explode(Object=pull, Component="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")  # -> Id, DisplayName, Name, Tags, BHoM_Guid
panel_3 = Panel(explode_2.DisplayName)
